# Dynamo graph Manholes - Drainage Ditches.dyn "Manholes_-_Battery_Room_Drainage" (Dynamo 2.19.3.6394)
# Places a family at each manhole/structure location from CSV, sets Mark and height parameters

# group: 2. SELECT FAMILY + LEVEL
# Choose the family type and level to place on
family_types = FamilyTypes("g-PLM-PIN_Storm+Foulwater_Manhole_R21:Manhole Cone DN 1000")  # graph input
levels = Levels("UG Services Reference Level")  # graph input

# group: 1. SELECT CSV FILE
# Point to your *_structures.csv file
file_path = Filename("data_processed\HEL11-C3D-CIV - Drainage Battery Room Model DATA_structures.csv")  # graph input
boolean = BoolSelector(true)

importCSV = Data.ImportCSV(filePath=file_path, transpose=boolean)
string = StringInput("Slab_Thickness")
parameterByName = Parameter.ParameterByName(element=family_types, name=string)
value = Parameter.Value(parameter=parameterByName)
code_block = CodeBlock(data=importCSV, slab_thk=value)
# ---------- code_block.designscript (7 lines) ----------
rows = List.RestOfItems(data);
t = List.Transpose(rows);
names = t[0];
x = t[2];
y = t[3];
z_rim = t[4];
depth = t[7] + slab_thk;
# ----------------------------------------
byCoordinates = Point.ByCoordinates(x=code_block.x, y=code_block.y, z=code_block.z_rim)
byPointAndLevel = FamilyInstance.ByPointAndLevel(familyType=family_types, point=byCoordinates, level=levels)
mark_param_name = CodeBlock { "Mark"; }
set_mark = Element.SetParameterByName(element=byPointAndLevel, parameterName=mark_param_name, value=code_block.names)
height_param_name = StringInput("Height")  # graph input
set_height = Element.SetParameterByName(element=set_mark, parameterName=height_param_name, value=code_block.depth)
number = DoubleInput(70000)
watch = Watch(code_block.z_rim)
