# Dynamo graph Manholes - Battery Room.dyn (Dynamo 2.19.3.6394)
# Places manholes for Battery Room from CSV

number = DoubleInput(70000)

# group: 2. SELECT FAMILY + LEVEL
# Choose the family type and level to place on
family_types = FamilyTypes("g-PLM-PIN_Storm+Foulwater_Manhole_R21:Manhole Cone DN 1000")  # graph input
levels = Levels("UG Services Reference Level")  # graph input

# group: 1. SELECT CSV FILE
# Point to your *_structures.csv file
file_path = Filename("manholes\HEL11-C3D-CIV - Drainage Battery Room Model_manholes.csv")  # graph input
boolean = BoolSelector(true)

importCSV = Data.ImportCSV(filePath=file_path, transpose=boolean)
string = StringInput("Slab_Thickness")
parameterByName = Parameter.ParameterByName(element=family_types, name=string)
value = Parameter.Value(parameter=parameterByName)
code_block = CodeBlock(data=importCSV, slab_thk=value)
# ---------- code_block.designscript (7 lines) ----------
rows = List.RestOfItems(data);
t = List.Transpose(rows);
names = t[0];
x = t[2];
y = t[3];
z_rim = t[4];
depth = t[7] + slab_thk;
# ----------------------------------------
z_0_place_at_level = DoubleInput(0)
byCoordinates = Point.ByCoordinates(x=code_block.x, y=code_block.y, z=z_0_place_at_level)
byPointAndLevel = FamilyInstance.ByPointAndLevel(familyType=family_types, point=byCoordinates, level=levels)
mark_param_name = CodeBlock { "Mark"; }
set_mark = Element.SetParameterByName(element=byPointAndLevel, parameterName=mark_param_name, value=code_block.names)
height_param_name = StringInput("Height")  # graph input
set_height = Element.SetParameterByName(element=set_mark, parameterName=height_param_name, value=code_block.depth)

# group: 3. SET ELEVATION FROM LEVEL
# Converts Z_Rim (mm) to feet and sets Elevation from Level parameter
elevation_param_name = StringInput("Elevation from Level")  # graph input
z_rim_mm_to_ft = CodeBlock(z_rim_str=code_block.z_rim) { z_ft = String.ToNumber(z_rim_str) / 304.8; }
set_elevation_from_level = Element.SetParameterByName(element=set_height, parameterName=elevation_param_name, value=z_rim_mm_to_ft)

# group: 4. SET XY COORDINATES
# Writes X and Y from CSV into X Coordinate and Y Coordinate parameters
x_param_name = StringInput("X Coordinate")  # graph input
set_x_coordinate = Element.SetParameterByName(element=set_elevation_from_level, parameterName=x_param_name, value=code_block.x)
y_param_name = StringInput("Y Coordinate")  # graph input
set_y_coordinate = Element.SetParameterByName(element=set_x_coordinate, parameterName=y_param_name, value=code_block.y)

watch = Watch(set_y_coordinate)
