# Dynamo graph Pipes - Foul Water.dyn (Dynamo 2.19.3.6394)
# packages: MEPover 2024.9.25

element_classes = ElementTypes("PipingSystemType")
all_elements_of_class = ElementsOfType(element_class=element_classes)
code_block = CodeBlock(x=all_elements_of_class, b=all_elements_of_class) { x.Name; b[40]; }
watch = Watch(code_block.out0)
element_classes_2 = ElementTypes("PipeType")
all_elements_of_class_2 = ElementsOfType(element_class=element_classes_2)
code_block_2 = CodeBlock(x=all_elements_of_class_2, a=all_elements_of_class_2) { x.Name; a[6]; }
watch_2 = Watch(code_block_2.out0)
file_path = Filename("..\pipes\HEL11-C3D-CIV - Drainage Foul Water Model_pipes.csv")
boolean = BoolSelector(true)
importCSV = Data.ImportCSV(filePath=file_path, transpose=boolean)
file_path_2 = Filename("..\XML data\revit_configs\z_offset.csv")
boolean_2 = BoolSelector(false)
importCSV_2 = Data.ImportCSV(filePath=file_path_2, transpose=boolean_2)
code_block_3 = CodeBlock(data=importCSV, z_offset=importCSV_2)
# ---------- code_block_3.designscript (13 lines) ----------
rows = List.RestOfItems(data);
t = List.Transpose(rows);
z_off = z_offset[0][1];
sx = t[0];
sy = t[1];
sz = t[2];
sz_off = sz + z_off;
ex = t[3];
ey = t[4];
ez = t[5];
ez_off = ez + z_off;
dia = t[6];
pipeName = t[7];
# ----------------------------------------
byCoordinates = Point.ByCoordinates(x=code_block_3.sx, y=code_block_3.sy, z=code_block_3.sz_off)
byCoordinates_2 = Point.ByCoordinates(x=code_block_3.ex, y=code_block_3.ey, z=code_block_3.ez_off)
byStartPointEndPoint = Line.ByStartPointEndPoint(startPoint=byCoordinates, endPoint=byCoordinates_2)
levels = Levels("UG Services Reference Level")
byLines = Custom[Pipe.ByLines](Lines=byStartPointEndPoint, PipeType=code_block_2.out1, SystemType=code_block.out1, level=levels, Diameter=code_block_3.dia)  # package MEPover; Creates a pipe by Line, PipeType, SystemType, Level and Diameter
x_param_name = StringInput("Mark")  # graph input
set_x_coordinate = Element.SetParameterByName(element=byLines, parameterName=x_param_name, value=code_block_3.pipeName)
