# Dynamo graph pipes_manholes_combined.dyn (Dynamo 2.19.3.6394)
# Places a family at each manhole/structure location from CSV, sets Mark and height parameters
# packages: MEPover 2024.9.25

# group: 2. SELECT FAMILY + LEVEL
# Choose the family type and level to place on
family_types = FamilyTypes("g-PLM-PIN_Storm+Foulwater_Manhole_R21:Manhole Cone DN 1000")  # graph input
levels = Levels("UG Services Reference Level")  # graph input

# group: 1. SELECT CSV FILE
# Point to your *_structures.csv file
file_path = Filename("No file selected.")
boolean = BoolSelector(true)

importCSV = Data.ImportCSV(filePath=file_path, transpose=boolean)
string = StringInput("Slab_Thickness")
parameterByName = Parameter.ParameterByName(element=family_types, name=string)
value = Parameter.Value(parameter=parameterByName)
code_block = CodeBlock(data=importCSV, slab_thk=value)
# ---------- code_block.designscript (7 lines) ----------
rows = List.RestOfItems(data);
t = List.Transpose(rows);
names = t[0];
x = t[2];
y = t[3];
z_rim = t[4];
depth = t[7] + slab_thk;
# ----------------------------------------
byCoordinates = Point.ByCoordinates(x=code_block.x, y=code_block.y, z=code_block.z_rim)
byPointAndLevel = FamilyInstance.ByPointAndLevel(familyType=family_types, point=byCoordinates, level=levels)
mark_param_name = CodeBlock { "Mark"; }
set_mark = Element.SetParameterByName(element=byPointAndLevel, parameterName=mark_param_name, value=code_block.names)
height_param_name = StringInput("Height")  # graph input
set_height = Element.SetParameterByName(element=set_mark, parameterName=height_param_name, value=code_block.depth)
number = DoubleInput(70000)
watch = Watch(code_block.z_rim)
file_path_2 = Filename("No file selected.")
boolean_2 = BoolSelector(true)
importCSV_2 = Data.ImportCSV(filePath=file_path_2, transpose=boolean_2)
code_block_2 = CodeBlock(data=importCSV_2)
# ---------- code_block_2.designscript (9 lines) ----------
rows = List.RestOfItems(data);
t = List.Transpose(rows);
sx = t[0];
sy = t[1];
sz = t[2];
ex = t[3];
ey = t[4];
ez = t[5];
dia = t[6];
# ----------------------------------------
byCoordinates_2 = Point.ByCoordinates(x=code_block_2.sx, y=code_block_2.sy, z=code_block_2.sz)
byCoordinates_3 = Point.ByCoordinates(x=code_block_2.ex, y=code_block_2.ey, z=code_block_2.ez)
byStartPointEndPoint = Line.ByStartPointEndPoint(startPoint=byCoordinates_2, endPoint=byCoordinates_3)
element_classes = ElementTypes("PipeType")
all_elements_of_class = ElementsOfType(element_class=element_classes)
code_block_3 = CodeBlock(x=all_elements_of_class, a=all_elements_of_class) { x.Name; a[17]; }
element_classes_2 = ElementTypes("PipingSystemType")
all_elements_of_class_2 = ElementsOfType(element_class=element_classes_2)
code_block_4 = CodeBlock(x=all_elements_of_class_2, b=all_elements_of_class_2) { x.Name; b[20]; }
levels_2 = Levels("UG Services Reference Level")
byLines = Custom[Pipe.ByLines](Lines=byStartPointEndPoint, PipeType=code_block_3.out1, SystemType=code_block_4.out1, level=levels_2, Diameter=code_block_2.dia)  # package MEPover; Creates a pipe by Line, PipeType, SystemType, Level and Diameter
watch_2 = Watch(code_block_4.out0)
watch_3 = Watch(importCSV_2)
watch_4 = Watch(code_block_3.out0)
