# Dynamo graph Pipes.dyn "Pipes - Drainage Ditches" (Dynamo 2.19.3.6394)
# packages: MEPover 2024.9.25

file_path = Filename("data_processed\HEL11-C3D-CIV - Drainage Ditches_pipes.csv")
boolean = BoolSelector(true)
importCSV = Data.ImportCSV(filePath=file_path, transpose=boolean)
code_block = CodeBlock(data=importCSV)
# ---------- code_block.designscript (9 lines) ----------
rows = List.RestOfItems(data);
t = List.Transpose(rows);
sx = t[0];
sy = t[1];
sz = t[2];
ex = t[3];
ey = t[4];
ez = t[5];
dia = t[6];
# ----------------------------------------
byCoordinates = Point.ByCoordinates(x=code_block.sx, y=code_block.sy, z=code_block.sz)
byCoordinates_2 = Point.ByCoordinates(x=code_block.ex, y=code_block.ey, z=code_block.ez)
byStartPointEndPoint = Line.ByStartPointEndPoint(startPoint=byCoordinates, endPoint=byCoordinates_2)
element_classes = ElementTypes("PipeType")
all_elements_of_class = ElementsOfType(element_class=element_classes)
code_block_2 = CodeBlock(x=all_elements_of_class, a=all_elements_of_class) { x.Name; a[17]; }
element_classes_2 = ElementTypes("PipingSystemType")
all_elements_of_class_2 = ElementsOfType(element_class=element_classes_2)
code_block_3 = CodeBlock(x=all_elements_of_class_2, b=all_elements_of_class_2) { x.Name; b[20]; }
levels = Levels("UG Services Reference Level")
byLines = Custom[Pipe.ByLines](PipeType=code_block_2.out1, SystemType=code_block_3.out1, level=levels, Diameter=code_block.dia)  # package MEPover; Creates a pipe by Line, PipeType, SystemType, Level and Diameter; unwired: Lines
watch = Watch(code_block_3.out0)
watch_2 = Watch(importCSV)
watch_3 = Watch(code_block_2.out0)
