# Dynamo graph manholes.dyn "Manholes_master" (Dynamo 2.19.3.6394)
# Places manholes from config-driven CSV lookup with dropdown selector, sets elevation, XY coords, mark, height, and workset

number = DoubleInput(70000)

# group: 2. SELECT FAMILY + LEVEL
# Choose the family type and level to place on
family_types = FamilyTypes("g-PLM-PIN_Storm+Foulwater_Manhole_R21:Manhole Cone DN 900")  # graph input
levels = Levels("UG Services Reference Level")  # graph input

file_path = Filename("..\..\..\..\..\..\..\..\..\..\..\Desktop\drainage_processor\02_Dynamo_Scripts\config_global_settings.csv")
boolean = BoolSelector(true)
importCSV = Data.ImportCSV(filePath=file_path, transpose=boolean)
file_path_2 = Filename("..\..\..\..\..\..\..\..\..\..\..\Desktop\drainage_processor\02_Dynamo_Scripts\config_drainage_settings.csv")
boolean_2 = BoolSelector(true)
importCSV_2 = Data.ImportCSV(filePath=file_path_2, transpose=boolean_2)
drainage_type = CustomSelection("BATTERY ROOM", items={DRAINAGE DITCHES: "DRAINAGE DITCHES", BATTERY ROOM: "BATTERY ROOM", FOUL WATER: "FOUL WATER", OILY WATER: "OILY WATER", RAINWATER: "RAINWATER", SUB SOIL: "SUB SOIL", SW + CP: "SW + CP"})
code_block = CodeBlock(config_global=importCSV, config_drainage=importCSV_2, drainage_type=drainage_type)
# ---------- code_block.designscript (8 lines) ----------
config_global;
rows = List.RestOfItems(config_drainage);
t = List.Transpose(rows);
types = t[0];
idx = List.IndexOf(types, drainage_type);
workset = t[1][idx];
mh_path = t[2][idx];
pipe_path = t[3][idx];
# ----------------------------------------
boolean_3 = BoolSelector(true)
data_importcsv_manhole_data = Data.ImportCSV(filePath=code_block.mh_path, transpose=boolean_3)
string = StringInput("Slab_Thickness")
parameterByName = Parameter.ParameterByName(element=family_types, name=string)
value = Parameter.Value(parameter=parameterByName)
code_block_2 = CodeBlock(data=data_importcsv_manhole_data, slab_thk=value)
# ---------- code_block_2.designscript (7 lines) ----------
rows = List.RestOfItems(data);
t = List.Transpose(rows);
names = t[0];
x = t[2];
y = t[3];
z_rim = t[4];
depth = t[7] + slab_thk;
# ----------------------------------------
z_0_place_at_level = DoubleInput(0)
byCoordinates = Point.ByCoordinates(x=code_block_2.x, y=code_block_2.y, z=z_0_place_at_level)
byPointAndLevel = FamilyInstance.ByPointAndLevel(familyType=family_types, point=byCoordinates, level=levels)
mark_param_name = CodeBlock { "Mark"; }
set_mark = Element.SetParameterByName(element=byPointAndLevel, parameterName=mark_param_name, value=code_block_2.names)
height_param_name = StringInput("Height")  # graph input

# group: 3. SET ELEVATION FROM LEVEL
# Converts Z_Rim (mm) to feet and sets Elevation from Level parameter
set_height = Element.SetParameterByName(element=set_mark, parameterName=height_param_name, value=code_block_2.depth)
elevation_param_name = StringInput("Elevation from Level")  # graph input
set_elevation_from_level = Element.SetParameterByName(element=set_height, parameterName=elevation_param_name, value=code_block_2.z_rim)

# group: 4. SET XY COORDINATES
# Writes X and Y from CSV into X Coordinate and Y Coordinate parameters
x_param_name = StringInput("X Coordinate")  # graph input
set_x_coordinate = Element.SetParameterByName(element=set_elevation_from_level, parameterName=x_param_name, value=code_block_2.x)
y_param_name = StringInput("Y Coordinate")  # graph input
set_y_coordinate = Element.SetParameterByName(element=set_x_coordinate, parameterName=y_param_name, value=code_block_2.y)

string_2 = StringInput("Workset")
python_script = Python(IN[0]=[code_block.workset, code_block.workset])  # CPython3
# ---------- python_script.python (13 lines) ----------
import clr
clr.AddReference('RevitAPI')
from Autodesk.Revit.DB import *
from RevitServices.Persistence import DocumentManager

doc = DocumentManager.Instance.CurrentDBDocument

ws_name = str(IN[0]).strip()

for ws in FilteredWorksetCollector(doc).OfKind(WorksetKind.UserWorkset):
    if ws.Name.strip() == ws_name:
        OUT = ws.Id.IntegerValue
        break
# ----------------------------------------
setParameterByName = Element.SetParameterByName(element=set_y_coordinate, parameterName=[string_2, string_2], value=[python_script, python_script])
watch = Watch(setParameterByName)
