# Dynamo graph pipes.dyn "pipes_main" (Dynamo 2.19.3.6394)
# packages: MEPover 2024.9.25

element_classes = ElementTypes("PipingSystemType")
all_elements_of_class = ElementsOfType(element_class=element_classes)
code_block = CodeBlock(x=all_elements_of_class, b=all_elements_of_class) { x.Name; b[20]; }
watch = Watch(code_block.out0)
element_classes_2 = ElementTypes("PipeType")
all_elements_of_class_2 = ElementsOfType(element_class=element_classes_2)
code_block_2 = CodeBlock(x=all_elements_of_class_2, a=all_elements_of_class_2) { x.Name; a[17]; }
watch_2 = Watch(code_block_2.out0)
file_path = Filename("..\..\..\..\..\..\..\..\..\..\..\Desktop\drainage_processor\02_Dynamo_Scripts\config_global_settings.csv")
boolean = BoolSelector(true)
importCSV = Data.ImportCSV(filePath=file_path, transpose=boolean)
file_path_2 = Filename("..\..\..\..\..\..\..\..\..\..\..\Desktop\drainage_processor\02_Dynamo_Scripts\config_drainage_settings.csv")
boolean_2 = BoolSelector(true)
importCSV_2 = Data.ImportCSV(filePath=file_path_2, transpose=boolean_2)
drainage_type = CustomSelection("DRAINAGE DITCHES", items={DRAINAGE DITCHES: "DRAINAGE DITCHES", BATTERY ROOM: "BATTERY ROOM", FOUL WATER: "FOUL WATER", OILY WATER: "OILY WATER", RAINWATER: "RAINWATER", SUB SOIL: "SUB SOIL", SW + CP: "SW + CP"})
code_block_3 = CodeBlock(config_global=importCSV, config_drainage=importCSV_2, drainage_type=drainage_type)
# ---------- code_block_3.designscript (8 lines) ----------
z_off = config_global[1][0];
rows = List.RestOfItems(config_drainage);
t = List.Transpose(rows);
types = t[0];
idx = List.IndexOf(types, drainage_type);
workset = t[1][idx];
mh_path = t[2][idx];
pipe_path = t[3][idx];
# ----------------------------------------
boolean_3 = BoolSelector(true)
importCSV_3 = Data.ImportCSV(filePath=code_block_3.pipe_path, transpose=boolean_3)
code_block_4 = CodeBlock(data=importCSV_3, z_off=code_block_3.z_off)
# ---------- code_block_4.designscript (10 lines) ----------
rows = List.RestOfItems(data);
t = List.Transpose(rows);
sx = t[0];
sy = t[1];
sz = t[2] + z_off;
ex = t[3];
ey = t[4];
ez = t[5] + z_off;
dia = t[6];
mark = t[7];
# ----------------------------------------
byCoordinates = Point.ByCoordinates(x=code_block_4.sx, y=code_block_4.sy, z=code_block_4.sz)
byCoordinates_2 = Point.ByCoordinates(x=code_block_4.ex, y=code_block_4.ey, z=code_block_4.ez)
byStartPointEndPoint = Line.ByStartPointEndPoint(startPoint=byCoordinates, endPoint=byCoordinates_2)
levels = Levels("UG Services Reference Level")
byLines = Custom[Pipe.ByLines](Lines=byStartPointEndPoint, PipeType=code_block_2.out1, SystemType=code_block.out1, level=levels, Diameter=code_block_4.dia)  # package MEPover; Creates a pipe by Line, PipeType, SystemType, Level and Diameter
string = StringInput("Mark")
setParameterByName = Element.SetParameterByName(element=byLines, parameterName=string, value=code_block_4.mark)
string_2 = StringInput("Workset")
python_script = Python(IN[0]=code_block_3.workset)  # CPython3
# ---------- python_script.python (13 lines) ----------
import clr
clr.AddReference('RevitAPI')
from Autodesk.Revit.DB import *
from RevitServices.Persistence import DocumentManager

doc = DocumentManager.Instance.CurrentDBDocument

ws_name = str(IN[0]).strip()

for ws in FilteredWorksetCollector(doc).OfKind(WorksetKind.UserWorkset):
    if ws.Name.strip() == ws_name:
        OUT = ws.Id.IntegerValue
        break
# ----------------------------------------
setParameterByName_2 = Element.SetParameterByName(element=setParameterByName, parameterName=string_2, value=python_script)
