# Dynamo graph place_structures_from_csv_V1.0.dyn (Dynamo 2.19.3.6394)
# Places a family at each manhole/structure location from CSV, sets Mark and height parameters

# group: 2. SELECT FAMILY + LEVEL
# Choose the family type and level to place on
family_types = FamilyTypes("g-PLM-PIN_Storm+Foulwater_Manhole_R21:Manhole Cone DN 1000")  # graph input
levels = Levels("PLAN CUT 1 +71.180")  # graph input

# group: 1. SELECT CSV FILE
# Point to your *_structures.csv file
file_path = Filename("data_processed\HEL11-C3D-CIV - Drainage Battery Room Model no test_structures.csv")  # graph input
boolean = BoolSelector(true)

importCSV = Data.ImportCSV(filePath=file_path, transpose=boolean)
elevation = Level.Elevation(level=levels)
parse_csv_columns = CodeBlock(data=importCSV, lev=elevation)
# ---------- parse_csv_columns.designscript (8 lines) ----------
rows = List.RestOfItems(data);
t = List.Transpose(rows);
names = t[0];
x = t[2];
y = t[3];
z_rim = t[4];
depth = t[7];
z_place = z_rim + lev;
# ----------------------------------------
byCoordinates = Point.ByCoordinates(x=parse_csv_columns.x, y=parse_csv_columns.y, z=parse_csv_columns.z_rim)
byPointAndLevel = FamilyInstance.ByPointAndLevel(familyType=family_types, point=byCoordinates, level=levels)
mark_param_name = CodeBlock { "Mark"; }
set_mark = Element.SetParameterByName(element=byPointAndLevel, parameterName=mark_param_name, value=[parse_csv_columns.names, parse_csv_columns.names])

# group: 3. EDIT HEIGHT PARAM NAME
# Change 'Height' to match your family's parameter name
height_param_name = StringInput("Height")  # graph input

set_height = Element.SetParameterByName(element=set_mark, parameterName=height_param_name, value=[parse_csv_columns.depth, parse_csv_columns.depth])
watch = Watch(parse_csv_columns.rows)
